# Grasshopper definition 20211031_Drain_mod.gh (Grasshopper 1.0.7)
# plug-ins: Kangaroo2 Components

mesh = Mesh(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)
clean = CombineClean(Meshes=mesh)
clean_2 = CombineClean(Meshes=mesh)
c_script = CSharpScript(mesh=clean, numPart=Slider(5000, range=0..5000), its=Slider(100, range=0..100), tol=Slider(0.4, range=0..1))  # -> out, A, B; inputs mesh: Mesh, numPart: Int32, its: Int32, tol: Double
# ---------- c_script: C# usings ----------
using System.IO;
using System.Linq;
using System.Data;
using System.Drawing;
using System.Reflection;
using System.Windows.Forms;
using System.Xml;
using System.Xml.Linq;
using System.Runtime.InteropServices;

using Rhino.DocObjects;
using Rhino.Collections;
using GH_IO;
using GH_IO.Serialization;
# ---------- c_script: C# ----------
    //
    //    List < Point3d > particles = new List<Point3d>(){particle};
    //    //Current particle plane
    //    Plane plane;
    //    plane = new Plane(particle, Vector3d.ZAxis);
    //
    //
    //    for (int i = 0; i < its; i++)
    //    {
    //      MeshPoint partPt = mesh.ClosestMeshPoint(plane.Origin, double.MaxValue);
    //      plane = new Plane(partPt.Point, mesh.NormalAt(partPt));
    //
    //      if(particles.Count > 1 && plane.Origin.Z > particles[i - 1].Z)
    //        break;
    //
    //      else
    //      {
    //        //Add particle to list
    //        particles.Add(plane.Origin);
    //        //Move particle down slope
    //        double angle = Vector3d.VectorAngle(plane.XAxis, -Vector3d.ZAxis, plane);
    //        plane.Rotate(angle, plane.ZAxis);
    //        plane.Translate(plane.XAxis * tol);
    //      }
    //
    //    }
    //    var  curve = Curve.CreateControlPointCurve(particles);
    //    A = curve;
    //
    //
    DrainSystem ds = new DrainSystem(mesh, numPart, tol, its);
    A = ds.GetPaths();
# ---------- c_script: C# additional code ----------
  public class DrainSystem
  {
    //Properties
    public Mesh Mesh;
    public int ParticleNumber;
    public double Tol;
    public int Iterations;
    public List<Curve> Paths = new List<Curve>();
    public List<Particle> Particles = new List<Particle>();
    Random random = new Random();

    //Constructor
    public DrainSystem(Mesh mesh, int particleNumber, double tol, int iterations)
    {
      Mesh = mesh;
      ParticleNumber = particleNumber;
      Tol = tol;
      Iterations = iterations;

      MakeParticles();
    }

    //Methods

    public List<Curve> GetPaths()
    {
      for (int i = 0; i < Particles.Count; i++)
      {


        for (int j = 0; j < Iterations; j++)
        {
          MeshPoint partPt = Mesh.ClosestMeshPoint(Particles[i].Plane.Origin, double.MaxValue);
          Particles[i].Plane = new Plane(partPt.Point, Mesh.NormalAt(partPt));

          if(Particles[i].Path.Count > 1 && Particles[i].Plane.Origin.Z > Particles[i].Path[j - 1].Z)
            break;

          else
          {
            // Add particle to list
            Particles[i].Path.Add(Particles[i].Plane.Origin);
            // Move particle down slope
            double angle = Vector3d.VectorAngle(Particles[i].Plane.XAxis, -Vector3d.ZAxis, Particles[i].Plane);
            Particles[i].Plane.Rotate(angle, Particles[i].Plane.ZAxis);
            Particles[i].Plane.Translate(Particles[i].Plane.XAxis * Tol);
          }
        }
        Paths.Add(Curve.CreateControlPointCurve(Particles[i].Path));
      }
      return Paths;
    }

    public void MakeParticles()
    {
      for (int i = 0; i < ParticleNumber; i++)
      {
        int temp = random.Next(0, Mesh.Vertices.Count);
        Particles.Add(new Particle(Mesh.Vertices[temp], new Plane(Mesh.Vertices[temp], Vector3d.ZAxis)));
      }
    }
  }

  public class Particle
  {
    //Properties
    public Point3d Position;
    public Plane Plane;
    public List<Point3d> Path = new List<Point3d>();
    //Constructor
    public Particle(Point3d position, Plane plane)
    {
      Position = position;
      Plane = plane;
      Path.Add(Position);
    }
  }
# ---------- end c_script ----------
c_script_2 = CSharpScript(
    m=clean_2,
    W=Slider(1.53, range=0..10),
    step=Slider(0.0311, range=0.0001..0.1),
    loop=Slider(300, range=0..5000),
    t=Slider(1.68, range=0.02..10))  # -> out, Indices, Heigth; inputs m: Mesh, W: Double, step: Double, loop: Int32, t: Double
# ---------- c_script_2: C# ----------
    //Based on this paper:
    //A flooding algorithm for extracting drainage networks from unprocessed digital elevation models

    var indices = new List<int>();
    var heigth = new List<double>();

    Drainsystem ds = new Drainsystem(m, W, step);
    for (int i = 0; i < loop; i++)
      ds.Splill();


    for (int i = 0; i < ds.CellCount; i++)
    {
      if(ds.Cells[i].ZW - ds.Cells[i].Altitude > t)
      {
        indices.Add(i);
        heigth.Add(ds.Cells[i].Heigth);
      }
    }
    Indices = indices;
    Heigth = heigth;
# ---------- c_script_2: C# additional code ----------
  public class Cell
  {
    //Properties
    public double Altitude = 0.0;//Z.Heigth
    public int[] Neighbours;
    public double Heigth = 0;//W:Water
    public double ZW = 0.0; //ZW: Height+Water
    public bool IsBorder = false;

    //Constructor
    public Cell(){}

    public Cell(double altitude, double heigth, int[] neighbours, bool isBorder)
    {
      Altitude = altitude; //Z(c)
      Neighbours = neighbours;
      Heigth = heigth;
      ZW = altitude + heigth;
      IsBorder = isBorder;
    }
  }

  public class Drainsystem
  {
    //Properties
    public Cell[] Cells;
    public Mesh Mesh;
    public int CellCount = 0;
    public double Step = 0.0;

    //Constructor

    public Drainsystem(Mesh mesh, double heigth, double step)
    {
      Step = step;
      Mesh = mesh;
      CellCount = mesh.Faces.Count;
      Cells = new Cell [mesh.FaceNormals.Count];
      for (int i = 0; i < CellCount; i++)
      {
        Cells[i] = new Cell(mesh.Faces.GetFaceCenter(i).Z, heigth, mesh.Faces.AdjacentFaces(i), mesh.Faces.HasNakedEdges(i));
      }
    }

    // methods

    public int GetSteepestNeighbour(int index)
    {
      Cell actualCell = Cells[index];
      int[] neighbours = actualCell.Neighbours;
      var actual = actualCell.ZW;//actual heigth of center with water

      double lowest = double.MaxValue;
      int steepest = -1;
      for (int i = 0; i < neighbours.Length; i++)
      {
        if(Cells[neighbours[i]].ZW < actualCell.ZW)
        {
          steepest = neighbours[i];
          lowest = actualCell.ZW;
        }
      }
      return steepest;
    }

    public void Splill()
    {
     
      for (int i = 0; i < Cells.Length; i++)
      {

        Cell ac = Cells[i];
        if(ac.Heigth <= 0)continue;
        if(ac.IsBorder)
        {
          //   ac.Heigth = 0;
          continue;
        }

        int ln = GetSteepestNeighbour(i);
        if(ln == -1)continue;

        Cells[ln].ZW += Step;
        Cells[ln].Heigth += Step;
        ac.Heigth -= Step;
        ac.ZW -= Step;

      }
    }
  }
# ---------- end c_script_2 ----------
facen = FaceNormals(Mesh=clean_2)  # -> Centers, Normals
bnd = Bounds(Numbers=c_script_2.Heigth)
item = ListItem(List=facen.Centers, Index=c_script_2.Indices, Wrap=True)
dedomain = DeconstructDomain(Domain=bnd)  # -> Start, End
gradient = Gradient(
    LowerLimit=dedomain.End,
    UpperLimit=dedomain.Start,
    Parameter=c_script_2.Heigth,
    stops=[0: RGB(234, 38, 0), 0.25: RGB(234, 126, 0), 0.5: RGB(254, 244, 84), 0.75: RGB(173, 203, 249), 1: RGB(75, 107, 169)])
cloud = CloudDisplay(Points=item, Colours=gradient, Size=Slider(0.191, range=0..3), SpriteType=0)
