# Grasshopper definition edge_detection.gh (Grasshopper 1.0.7)

number_slider = Slider(200, range=0..200)
sqgrid = Square(Plane=PlaneXY(0, 0, 0), Size=1, ExtentX=number_slider, ExtentY=number_slider)  # -> Cells, flatten(Points)
image = ImageSampler(
    sqgrid.Points,
    FilePath="H:\My Drive\site_connectivity.png",
    Filter="Colour",
    Interpolate=False,
    Umax=200,
    Umin=0,
    Vmax=200,
    Vmin=0,
    Wrap=1)
circle = CircleCNR(Center=sqgrid.Points, Normal=Vector(0, 0, 1), Radius=Slider(0.421, range=0..1))
panel = Panel(image)
preview = CustomPreview(Geometry=circle, Material=panel)
panel_2 = Panel("original representation")
ahsv = SplitAHSV(Colour=image)  # -> Alpha, Hue, Saturation, Value
b_pi = Panel(ahsv.Value)
shift = ShiftList(List=ahsv.Value, Shift=1, Wrap=True)
b_pi_1 = Panel(shift)
subtraction = Subtraction(A=b_pi_1, B=b_pi)
panel_3 = Panel(subtraction)
abs = Absolute(Value=panel_3)
panel_4 = Panel(abs)
multiplication = Multiplication(A=panel_4, B=Slider(255, range=0..1000))
python = GhPythonScript(x=multiplication, y=Slider(42, range=0..255))  # -> out, a
# ---------- python: Python ----------
__author__ = "willi"
__version__ = "2023.02.09"

import rhinoscriptsyntax as rs
if x > y:
    a = 255
else:
    a = 0
# ---------- end python ----------
rgb = ColourRGB(Alpha=255, Red=python.a, Green=python.a, Blue=python.a)
preview_2 = CustomPreview(Geometry=circle, Material=rgb)
