# Grasshopper definition latent_space_vis.gh (Grasshopper 1.0.7)
# plug-ins: Human, GH_CPython, SonicMat

# ---- group: image paths
gh_cpython = GH_CPython(input="242")  # -> simplify(output); inputs input: list
#   port input: [required] - [type = int] - [default = None] Descripe your input here * bullet point. * bullet point
#   port output: indicate your output description here. refers to a new line.
# ---------- gh_cpython: Python ----------
import os

_rootfolder = 'G:\\My Drive\\phd_thesis_data\\deep_city\\pix2pix\\compiled\\combined\\thumbnails\\h-w\\cropped\\'
#dirs = os.listdir(_rootfolder)

output_ = []

#for dir in dirs:
    #output_.append(_rootfolder + dir)"""

for i in range(_input):
    output_.append(_rootfolder + "resized_" + str(i) + ".jpg")


print(output_)
# ---------- end gh_cpython ----------
panel = Panel(gh_cpython)
split = TextSplit(Text=panel, Separators="'")  # -> simplify(Result)
panel_2 = Panel(split)
item = ListItem(List=panel_2, Index="1", Wrap=True)  # -> flatten(Item)
panel_3 = Panel(item)

# ----
file = ReadFile(File="G:\My Drive\latent_space_mix_h-w.csv", PerLineParse=True)
python = GhPythonScript(x=file)  # -> out, a
# ---------- python: Python ----------
__author__ = "willi"
__version__ = "2023.03.03"

import rhinoscriptsyntax as rs

a = x.split(',')
# ---------- end python ----------
panel_4 = Panel(python.a)
item_2 = ListItem(List=panel_4, Index="0", Wrap=True)
item_3 = ListItem(List=panel_4, Index="1", Wrap=True)
item_4 = ListItem(List=panel_4, Index="2", Wrap=True)
panel_5 = Panel(item_4)
panel_6 = Panel(item_3)
panel_7 = Panel(item_2)
num = Number(simplify(panel_7))
num_2 = Number(simplify(panel_6))
num_3 = Number(simplify(panel_5))

# ---- group: nodes (images)
pt = ConstructPoint(XCoordinate=num, YCoordinate=num_2, ZCoordinate=num_3)  # -> flatten(Point)
number_slider = Slider(1.8, range=0..100)
geo = Geometry(pt)
box = CenterBox(Base=geo, X=number_slider, Y=number_slider, Z="0")
mat = Material(Surface=box, String=panel_3, Double=Slider(0, range=0..100))

# ----
item_5 = ListItem(List=box, Index="240", Wrap=True)
item_6 = ListItem(List=box, Index="241", Wrap=True)
subset = SubList(List=box, Domain="120 to 239", Wrap=True)  # -> List, Index
subset_2 = SubList(List=box, Domain="241", Wrap=True)  # -> List, Index
subset_3 = SubList(List=box, Domain="0 to 119", Wrap=True)  # -> List, Index
subset_4 = SubList(List=box, Domain="240", Wrap=True)  # -> List, Index
edges = BrepEdges(Brep=subset_3.List)  # -> Naked, Interior, NonManifold
edges_2 = BrepEdges(Brep=subset.List)  # -> Naked, Interior, NonManifold
edges_3 = BrepEdges(Brep=item_5)  # -> Naked, Interior, NonManifold
edges_4 = BrepEdges(Brep=item_6)  # -> Naked, Interior, NonManifold
X = UnitX(Factor=Slider(2, range=0..10))
number_slider_2 = Slider(7.5, range=0..10)
number_slider_3 = Slider(10, range=0..10)
move = Move(Geometry=item_6, Motion=X)  # -> Geometry, Transform
move_2 = Move(Geometry=item_5, Motion=X)  # -> Geometry, Transform
panel_8 = Panel("""NBI
LCw'""")
panel_9 = Panel("""eBird
LCw'""")
swatch = ColourSwatch(SwatchColor=RGB(194, 194, 194))

# ---- group: captions
join = TextJoin(Text=[panel_7, panel_6, panel_5], Join=", ")  # -> simplify(Result)
boxprop = BoxProperties(Box=box)  # -> Center, Diagonal, Area, Volume, Degeneracy
X_2 = UnitX(Factor=Slider(22, range=0..100))
move_3 = Move(Geometry=boxprop.Center, Motion=X_2)  # -> Geometry, Transform
panel_10 = Panel(join)
tag = TextTag3D(Location=move_3.Geometry, Text=flatten(panel_10), Size=1, Colour=swatch, Justification=7)

# ---- group: edges
crossref = CrossReference(ListA=boxprop.Center, ListB=boxprop.Center, CrossMode=1)  # -> ListA, ListB
ln = Line(StartPoint=crossref.ListA, EndPoint=crossref.ListB)
preview = CustomPreview(Geometry=ln, Material=swatch)
lt_table = LinetypeTable(Update=Toggle(True))  # -> Linetypes, LinetypePattern
panel_11 = Panel(lt_table.Linetypes)
item_7 = ListItem(List=flatten(lt_table.Linetypes), Index=Slider(1, range=0..5), Wrap=True)
panel_12 = Panel(item_7)
geo_2 = Geometry(ln)
createatts = CreateAttributes(LinetypeName=panel_12, PlotColor=swatch, enableFullPath=False)
previewlw = CustomPreviewLineweights(Geometry=geo_2, Shader=swatch, Thickness=Slider(0, range=0..5), Absolute=Toggle(False))
bake = BakeGeometry(Bake=Button(), Geometry=geo_2, Attributes=createatts, DeleteOldBakes=False, PreserveTrees=False)

# ----
swatch_2 = ColourSwatch(SwatchColor=RGB(255, 0, 0))
previewlw_2 = CustomPreviewLineweights(Geometry=edges_3.Naked, Shader=swatch_2, Thickness=number_slider_3, Absolute=False)
previewlw_3 = CustomPreviewLineweights(Geometry=edges_4.Naked, Shader=swatch_2, Thickness=number_slider_3, Absolute=False)
tag_2 = TextTag3D(Location=move.Geometry, Text=flatten(panel_9), Size=1, Colour=swatch_2, Justification=7)
tag_3 = TextTag3D(Location=move_2.Geometry, Text=flatten(panel_8), Size=1, Colour=swatch_2, Justification=7)
swatch_3 = ColourSwatch(SwatchColor=RGB(106, 222, 222))
previewlw_4 = CustomPreviewLineweights(Geometry=edges.Naked, Shader=swatch_3, Thickness=number_slider_2, Absolute=False)
swatch_4 = ColourSwatch(SwatchColor=RGB(154, 71, 178))
swatch_5 = ColourSwatch(SwatchColor=RGB(178, 166, 71))
previewlw_5 = CustomPreviewLineweights(Geometry=edges_2.Naked, Shader=swatch_5, Thickness=number_slider_2, Absolute=False)
move_4 = Move(Geometry=subset_3.List, Motion=X)  # -> Geometry, Transform
move_5 = Move(Geometry=subset.List, Motion=X)  # -> Geometry, Transform
series = Series(Start=0, Step=1, Count=120)
series_2 = Series(Start=0, Step=1, Count=120)
tag_4 = TextTag3D(Location=move_4.Geometry, Text=flatten(series), Size=Slider(0.5, range=0..5), Colour=swatch_3, Justification=7)
tag_5 = TextTag3D(Location=move_5.Geometry, Text=flatten(series_2), Size=Slider(0.5, range=0..5), Colour=swatch_5, Justification=7)
X_3 = UnitX(Factor=Slider(11, range=0..100))
pt_2 = ConstructPoint(XCoordinate="-0.942", YCoordinate="1.416", ZCoordinate="-0.759")
pt_3 = ConstructPoint(XCoordinate="0.123", YCoordinate="-2.479", ZCoordinate="0.987")
move_6 = Move(Geometry=boxprop.Center, Motion=X_3)  # -> Geometry, Transform
circle = CircleCNR(Center=pt_2, Normal=Vector(0, 0, 1), Radius=number_slider)
circle_2 = CircleCNR(Center=pt_3, Normal=Vector(0, 0, 1), Radius=number_slider)
divide = DivideCurve(Curve=circle, Count=4, Kinks=False)  # -> Points, Tangents, Parameters
divide_2 = DivideCurve(Curve=circle_2, Count=4, Kinks=False)  # -> Points, Tangents, Parameters
item_8 = ListItem(List=divide.Points, Index="0", Wrap=True)
item_9 = ListItem(List=divide.Points, Index="1", Wrap=True)
item_10 = ListItem(List=divide.Points, Index="2", Wrap=True)
item_11 = ListItem(List=divide.Points, Index="3", Wrap=True)
item_12 = ListItem(List=divide_2.Points, Index="0", Wrap=True)
item_13 = ListItem(List=divide_2.Points, Index="1", Wrap=True)
item_14 = ListItem(List=divide_2.Points, Index="2", Wrap=True)
item_15 = ListItem(List=divide_2.Points, Index="3", Wrap=True)
ln_2 = Line(StartPoint=item_8, EndPoint=item_10)
ln_3 = Line(StartPoint=item_9, EndPoint=item_11)
ln_4 = Line(StartPoint=item_13, EndPoint=item_15)
ln_5 = Line(StartPoint=item_12, EndPoint=item_14)
geo_3 = Geometry([ln_2, ln_3])
geo_4 = Geometry([ln_5, ln_4])
number_slider_4 = Slider(2, range=0..10)
number_slider_5 = Slider(5, range=0..10)
X_4 = UnitX(Factor=number_slider_4)
X_5 = UnitX(Factor=number_slider_4)
move_7 = Move(Geometry=pt_3, Motion=X_4)  # -> Geometry, Transform
tag_6 = TextTag3D(Location=move_7.Geometry, Text=flatten("eBird Centroid"), Size=1, Colour=swatch_5, Justification=7)
move_8 = Move(Geometry=pt_2, Motion=X_5)  # -> Geometry, Transform
tag_7 = TextTag3D(Location=move_8.Geometry, Text=flatten("NBI Centroid"), Size=1, Colour=swatch_3, Justification=7)
previewlw_6 = CustomPreviewLineweights(Geometry=geo_4, Shader=swatch_5, Thickness=number_slider_5, Absolute=False)
previewlw_7 = CustomPreviewLineweights(Geometry=geo_3, Shader=swatch_3, Thickness=number_slider_5, Absolute=False)
