# Grasshopper definition voxel coordinates v2.gh (Grasshopper 1.0.7)

number_slider = Slider(3, range=0..10)
number_slider_2 = Slider(100, range=0..100)
series = Series(Start=0, Step=number_slider, Count=Slider(50, range=0..100))
sqgrid = Square(Plane=PlaneXY(0, 0, 0), Size=number_slider, ExtentX=number_slider_2, ExtentY=number_slider_2)  # -> Cells, Points
Z = UnitZ(Factor=series)
move = Move(Geometry=graft(sqgrid.Points), Motion=Z)  # -> flatten(Geometry), Transform

# ---- group: Model
brep = Brep(<brep referenced from the Rhino model>)

# ---- group: mesh model
mesh = Mesh(<mesh referenced from the Rhino model>)

# ----
minc = MeshInclusion(Mesh=mesh, Point=move.Geometry, Strict=Toggle(False))
brepinc = PointInBrep(Brep=brep, Point=move.Geometry, Strict=False)

# ---- group: voxel coordinates
cull = CullPattern(List=move.Geometry, CullPattern=minc)

cull_2 = CullPattern(List=move.Geometry, CullPattern=brepinc)

# ----
panel = Panel(cull)
panel_2 = Panel(cull_2)
